# Grasshopper definition HarmVis.gh (Grasshopper 1.0.7)
# plug-ins: MeshEdit Components

number_slider = Slider(30, range=10..80)
number_slider_2 = Slider(1, range=0..10)
number_slider_3 = Slider(0, range=0..100)

# ---- group: Second spherical harmonics representation
c_script = CSharpScript(n=number_slider, jvec=number_slider_3, svec=number_slider_2)  # -> out, P; inputs n: Int32, jvec: list of Int32, svec: list of Double
# ---------- c_script: C# ----------
    List<Point3d> lst_points = new List<Point3d> ();

    int[,] MLVec = getMLVec(12);

    for (int i = 0; i < n; i++)
    {
      double theta = Math.PI / (double) (n - 1) * (double) i;
      for (int j = 0; j < n; j++)
      {
        double phi = Math.PI * 2.0 / (double) (n - 1) * (double) j;

        double[] pt = get_pt(theta, phi, jvec, svec, MLVec);

        lst_points.Add(new Point3d(pt[0], pt[1], pt[2]));
      }

    }

    P = lst_points;
# ---------- c_script: C# additional code ----------
  public int[,] getMLVec(int Lmax)
  {
    int Jmax = Lmax * Lmax + 2 * Lmax + 1;
    int[,] MLVec = new int[Jmax, 2];

    for (int L = 0; L < Lmax + 1; L++)
    {
      for (int M = -L; M < L + 1; M++)
      {
        int j = L * L + L + M;
        MLVec[j, 0] = M;
        MLVec[j, 1] = L;
      }
    }
    return MLVec;
  }

  public double[] get_pt(double theta, double phi, List<int> jvec, List<double> svec, int[,] MLVec)
  {
    // calculate output point radius r
    double r = 0;
    for (int i = 0; i < jvec.Count; i++)
    {
      r += real_sph_harm(MLVec[jvec[i], 0], MLVec[jvec[i], 1], theta, phi) * svec[i];
    }

    // output point pt1
    double[] pt1 = sph2cart(r, theta, phi);
    return pt1;

  }


  // Classical real spherical harmonics in spherical coordinates in example from
  // Mézières, P., 2022.
  // Real spherical harmonics for lighting simulation and real-time rendering
  // PHD Thesis - Université Paul Sabatier - Toulouse III.

  public double real_sph_harm(int M_int, int L_int, double theta, double phi)
  {

    double M = Convert.ToDouble(M_int);
    double L = Convert.ToDouble(L_int);
    double K_lm_P_lm = K_lm(Math.Abs(M), L, Math.Abs(M_int), L_int) * P_lm(Math.Abs(M), L, Math.Abs(M_int), L_int, Math.Cos(theta));

    if(M_int < 0)
    {
      return Math.Sqrt(2.0) * K_lm_P_lm * Math.Sin(Math.Abs(M) * phi);
    }
    else if(M_int == 0)
    {
      return K_lm_P_lm;
    }
    else
    {
      return Math.Sqrt(2.0) * K_lm_P_lm * Math.Cos(M * phi);
    }

  }

  public double[] sph2cart(double r, double theta, double phi)
  {
    double x = r * Math.Sin(theta) * Math.Cos(phi);
    double y = r * Math.Sin(theta) * Math.Sin(phi);
    double z = r * Math.Cos(theta);

    double[] pt = new double[] {x,y,z};

    return pt;

  }

  // Calculate prefactor
  public double K_lm(double M, double L, int M_int, int L_int)
  {
    if(M_int == 0)
    {
      return Math.Sqrt((2.0 * L + 1.0) / (4.0 * Math.PI));
    }
    else
    {
      return 1.0 / Math.Sqrt((L + M) * (L + 1.0 - M)) * K_lm(M - 1, L, M_int - 1, L_int);
    }

  }

  // Calculate the associated Legendre polynomial of degree L and order M
  public double P_lm(double M, double L, int M_int, int L_int, double x)
  {
    if(M_int == 0 && L_int == 0)
    {
      return 1.0;
    }
    else if(M_int == 1 && L_int == 0)
    {
      return x;
    }
    else if(M_int == L_int)
    {
      if(1.0 - Math.Pow(x, 2.0) == 0)
      {
        return 0.0;
      }
      else
      {
        return DoubleFactorial(2 * M - 1) * Math.Pow(1.0 - Math.Pow(x, 2.0), 0.5 * M);
      }
    }
    else if(M_int == L_int - 1)
    {
      return x * (2.0 * M + 1.0) * P_lm(M, M, M_int, M_int, x);
    }
    else
    {
      return 1.0 / (L - M) * ( x * (2.0 * L - 1.0) * P_lm(M, L - 1.0, M_int, L_int - 1, x) - (L + M - 1.0) * P_lm(M, L - 2.0, M_int, L_int - 2, x) );
    }

  }

  // DoubleFactorial
  public double DoubleFactorial(double n)
  {
    if (n <= 1.0)
    {
      return 1.0;
    }
    else
    {
      return n * DoubleFactorial(n - 2.0);
    }
  }
# ---------- end c_script ----------
frompoints = MeshFromPoints(Points=c_script.P, UDirection=number_slider, VDirection=number_slider)
unim = UnifyMesh(Mesh=frompoints)  # -> Result, Count

# ---- group: Hemispherical harmonics
c_script_2 = CSharpScript(n=number_slider, jvec=number_slider_3, svec=number_slider_2)  # -> out, P; inputs n: Int32, jvec: list of Int32, svec: list of Double
# ---------- c_script_2: C# ----------
    List<Point3d> lst_points = new List<Point3d> ();

    int[,] MLVec = getMLVec(12);

    for (int i = 0; i < n; i++)
    {
      double theta = Math.PI / 2.0 / (double) (n - 1) * (double) i;
      for (int j = 0; j < n; j++)
      {
        double phi = Math.PI * 2.0 / (double) (n - 1) * (double) j;

        double[] pt = get_pt(theta, phi, jvec, svec, MLVec);

        lst_points.Add(new Point3d(pt[0], pt[1], pt[2]));
      }

    }

    P = lst_points;
# ---------- c_script_2: C# additional code ----------
  public int[,] getMLVec(int Lmax)
  {
    int Jmax = Lmax * Lmax + 2 * Lmax + 1;
    int[,] MLVec = new int[Jmax, 2];

    for (int L = 0; L < Lmax + 1; L++)
    {
      for (int M = -L; M < L + 1; M++)
      {
        int j = L * L + L + M;
        MLVec[j, 0] = M;
        MLVec[j, 1] = L;
      }
    }
    return MLVec;
  }

  public double[] get_pt(double theta, double phi, List<int> jvec, List<double> svec, int[,] MLVec)
  {
    // calculate output point radius r
    double r = 0;
    for (int i = 0; i < jvec.Count; i++)
    {
      r += real_sph_harm(MLVec[jvec[i], 0], MLVec[jvec[i], 1], theta, phi) * svec[i];
    }

    // output point pt1
    double[] pt1 = sph2cart(r, theta, phi);
    return pt1;

  }


  // Hemispherical harmonics from
  // Gautron, P., Krivánek, J., Pattanaik, S.N., Bouatouch, K., 2004.
  // A Novel Hemispherical Basis for Accurate and Efficient Rendering.
  // Rendering Techniques 2004, 321–330.

  public double real_sph_harm(int M_int, int L_int, double theta, double phi)
  {

    double M = Convert.ToDouble(M_int);
    double L = Convert.ToDouble(L_int);
    // with shifted associated legendre polynomials
    double K_lm_P_lm = K_lm(Math.Abs(M), L, Math.Abs(M_int), L_int) * P_lm(Math.Abs(M), L, Math.Abs(M_int), L_int, 2*Math.Cos(theta) - 1);

    if(M_int < 0)
    {
      return Math.Sqrt(2.0) * K_lm_P_lm * Math.Sin(Math.Abs(M) * phi);
    }
    else if(M_int == 0)
    {
      return K_lm_P_lm;
    }
    else
    {
      return Math.Sqrt(2.0) * K_lm_P_lm * Math.Cos(M * phi);
    }

  }

  public double[] sph2cart(double r, double theta, double phi)
  {
    double x = r * Math.Sin(theta) * Math.Cos(phi);
    double y = r * Math.Sin(theta) * Math.Sin(phi);
    double z = r * Math.Cos(theta);

    double[] pt = new double[] {x,y,z};

    return pt;

  }

  // Calculate prefactor
  public double K_lm(double M, double L, int M_int, int L_int)
  {
    if(M_int == 0)
    {
      return Math.Sqrt((2.0 * L + 1.0) / (2.0 * Math.PI));
    }
    else
    {
      return 1.0 / Math.Sqrt((L + M) * (L + 1.0 - M)) * K_lm(M - 1, L, M_int - 1, L_int);
    }

  }

  // Calculate the associated Legendre polynomial of degree L and order M
  public double P_lm(double M, double L, int M_int, int L_int, double x)
  {
    if(M_int == 0 && L_int == 0)
    {
      return 1.0;
    }
    else if(M_int == 1 && L_int == 0)
    {
      return x;
    }
    else if(M_int == L_int)
    {
      if(1.0 - Math.Pow(x, 2.0) == 0)
      {
        return 0.0;
      }
      else
      {
        return DoubleFactorial(2 * M - 1) * Math.Pow(1.0 - Math.Pow(x, 2.0), 0.5 * M);
      }
    }
    else if(M_int == L_int - 1)
    {
      return x * (2.0 * M + 1.0) * P_lm(M, M, M_int, M_int, x);
    }
    else
    {
      return 1.0 / (L - M) * ( x * (2.0 * L - 1.0) * P_lm(M, L - 1.0, M_int, L_int - 1, x) - (L + M - 1.0) * P_lm(M, L - 2.0, M_int, L_int - 2, x) );
    }

  }

  // DoubleFactorial
  public double DoubleFactorial(double n)
  {
    if (n <= 1.0)
    {
      return 1.0;
    }
    else
    {
      return n * DoubleFactorial(n - 2.0);
    }
  }
# ---------- end c_script_2 ----------
frompoints_2 = MeshFromPoints(Points=c_script_2.P, UDirection=number_slider, VDirection=number_slider)
unim_2 = UnifyMesh(Mesh=frompoints_2)  # -> Result, Count

# ---- group: First spherical harmonics representation
c_script_3 = CSharpScript(n=number_slider, jvec=number_slider_3, svec=number_slider_2)  # -> out, P; inputs n: Int32, jvec: list of Int32, svec: list of Double
# ---------- c_script_3: C# ----------
    List<Point3d> lst_points = new List<Point3d> ();
    int[,] MLVec = getMLVec(12);

    for (int i = 0; i < n; i++)
    {
      double theta = Math.PI / (double) (n - 1) * (double) i;
      for (int j = 0; j < n; j++)
      {
        double phi = Math.PI * 2.0 / (double) (n - 1) * (double) j;

        double[] pt = get_pt(theta, phi, jvec, svec, MLVec);

        lst_points.Add(new Point3d(pt[0], pt[1], pt[2]));
      }

    }

    P = lst_points;
# ---------- c_script_3: C# additional code ----------
  public int[,] getMLVec(int Lmax)
  {
    int Jmax = Lmax * Lmax + 2 * Lmax + 1;
    int[,] MLVec = new int[Jmax, 2];

    for (int L = 0; L < Lmax + 1; L++)
    {
      for (int M = -L; M < L + 1; M++)
      {
        int j = L * L + L + M;
        MLVec[j, 0] = M;
        MLVec[j, 1] = L;
      }
    }
    return MLVec;
  }

  public double[] get_pt(double theta, double phi, List<int> jvec, List<double> svec, int[,] MLVec)
  {
    // query point pt0
    double[] pt0 = sph2cart(1, theta, phi);
    double x0 = pt0[0];
    double y0 = pt0[1];
    double z0 = pt0[2];

    // calculate output point radius r
    double r = 0;
    for (int i = 0; i < jvec.Count; i++)
    {
      r += real_sph_harm(MLVec[jvec[i], 0], MLVec[jvec[i], 1], x0, y0, z0) * svec[i];
    }

    // output point pt1
    double[] pt1 = new double[] {r * x0,r * y0,r * z0};
    return pt1;

  }

  // This module is set up according to the equations in
  // Bigi, F., Fraux, G., Browning, N.J., Ceriotti, M., 2023.
  // Fast evaluation of spherical harmonics with sphericart.
  // The Journal of Chemical Physics 159, 064802.
  // https://doi.org/10.1063/5.0156307
  public double real_sph_harm(int M_int, int L_int, double x, double y, double z)
  {
    double M = Convert.ToDouble(M_int);
    double L = Convert.ToDouble(L_int);
    double Q_thildelm = F_lm(Math.Abs(M), L, Math.Abs(M_int), L_int) * Q_lm(Math.Abs(M), L, Math.Abs(M_int), L_int, z, 1);

    if(M_int < 0)
    {
      return Q_thildelm * s_m_xy(Math.Abs(M_int), x, y);
    }
    else if(M_int == 0)
    {
      return Q_thildelm / Math.Sqrt(2.0);
    }
    else
    {
      return Q_thildelm * c_m_xy(M_int, x, y);
    }

  }

  public double[] sph2cart(double r, double theta, double phi)
  {
    double x = r * Math.Sin(theta) * Math.Cos(phi);
    double y = r * Math.Sin(theta) * Math.Sin(phi);
    double z = r * Math.Cos(theta);

    double[] pt = new double[] {x,y,z};

    return pt;

  }

  // Calculate prefactor
  public double F_lm(double M, double L, int M_int, int L_int)
  {
    if(M_int == 0)
    {
      return Math.Sqrt((2.0 * L + 1.0) / (2.0 * Math.PI));
    }
    else
    {
      return -1.0 / Math.Sqrt((L + M) * (L + 1.0 - M)) * F_lm(M - 1, L, M_int - 1, L_int);
    }

  }

  // Calculate the associated Legendre polynomial of degree L and order M
  public double Q_lm(double M, double L, int M_int, int L_int, double z, double r)
  {

    if(L_int == M_int)
    {
      if(M_int == 0)
      {
        return 1.0;
      }
      else
      {
        return -(2.0 * L - 1.0) * Q_lm(L - 1, L - 1, L_int - 1, L_int - 1, z, r);
      }
    }
    else if(L_int < M_int)
    {
      return 0.0;
    }
    else if(M_int == L_int - 1)
    {
      return -z * Q_lm(L, L, L_int, L_int, z, r);
    }
    else
    {
      return 1.0 / (L - M) * ( (2.0 * L - 1.0) * z * Q_lm(M, L - 1, M_int, L_int - 1, z, r) - (L + M - 1.0) * r * r * Q_lm(M, L - 2, M_int, L_int - 2, z, r));
    }

  }

  // Calculate s_m_xy
  public double s_m_xy(int M, double x, double y)
  {

    if(M == 0)
    {
      return 0.0;
    }
    else
    {
      return x * s_m_xy(M - 1, x, y) + y * c_m_xy(M - 1, x, y);
    }

  }

  // Calculate c_m_xy
  public double c_m_xy(int M, double x, double y)
  {
    if(M == 0)
    {
      return 1.0;
    }
    else
    {
      return -y * s_m_xy(M - 1, x, y) + x * c_m_xy(M - 1, x, y);
    }

  }
# ---------- end c_script_3 ----------
frompoints_3 = MeshFromPoints(Points=c_script_3.P, UDirection=number_slider, VDirection=number_slider)
unim_3 = UnifyMesh(Mesh=frompoints_3)  # -> Result, Count
